# Dynamo graph IfcGetParametersAndTag.dyn (Dynamo 0.8.2.2095)

# note: Add the path to the IFC file you just opened. (there is no way to read the file path if the file is not saved first)
file_path = Filename("E:\DIMITAR\GitHub\Sports_Complex\IFC Roundtrip\FreeCAD Detail\detail_Yorik_notris.ifc")
categories = Categories("GenericModel")
# note: This is the depth at which elements will be tagged. Try to keep it to a realistic view depth.
# note: In our particular case all IFC elements are
# imported as Generic Models
view_depth_cut_off_distance_m = DoubleSlider(0.45, range=0.001..1 step 0.01)
# note: Please parametrize the width
# (W) and length (L) of your tag.
ifc_tag_type = FamilyTypes("Area Tag:Area Tag")
# note: Dynamo can't tell if you've change the scale, crop box or the active view inside Revit, after initially running the graph.  Please toggle this bool once to notify Dynamo of any changes.
refresh_view = BoolSelector(false)
multi_box_1 = Python(IN[0]=file_path, IN[1]=categories, IN[2]=view_depth_cut_off_distance_m, IN[3]=ifc_tag_type, IN[4]=refresh_view)
# ---------- multi_box_1.python (115 lines) ----------
import clr

clr.AddReference("RevitServices")
import RevitServices
from RevitServices.Persistence import DocumentManager
from RevitServices.Transactions import TransactionManager

doc = DocumentManager.Instance.CurrentDBDocument
uiapp = DocumentManager.Instance.CurrentUIApplication
app = uiapp.Application

clr.AddReference("System")
from System.Diagnostics import Process

clr.AddReference("RevitAPI")
from  Autodesk.Revit.DB import RevitLinkType, RevitLinkOptions, RevitLinkInstance, FilteredElementCollector, FilePath, ModelPathUtils, FilteredElementCollector, ElementCategoryFilter, DisplayUnitType, UnitUtils, SubTransaction
from  Autodesk.Revit.DB.IFC import *

clr.AddReference("RevitNodes")
import Revit
clr.ImportExtensions(Revit.Elements)
clr.ImportExtensions(Revit.GeometryConversion)

import sys
sys.path.append(r'C:\Program Files (x86)\IronPython 2.7\Lib')
import os

clr.AddReference('ProtoGeometry')
from Autodesk.DesignScript.Geometry import *

path = IN[0]
Cat1 = UnwrapElement(IN[1])
cutoff1 = IN[2]
IfcTag = IN[3]
#get active view's data
view = doc.ActiveView
view_or = view.Origin.ToPoint()
view_nr = view.ViewDirection.ToVector()
view_pl = Plane.ByOriginNormal(view_or,view_nr)
#link the IFC
newpath = path[:-3] + "RVT"
file_exists = os.path.exists(newpath)
link_exists = False

TransactionManager.Instance.EnsureInTransaction(doc)
if not file_exists:
	opt1 = IFCImportOptions()
	opt1.Action = IFCImportAction.Open
	opt1.Intent = IFCImportIntent.Reference
	newdoc = app.OpenIFCDocument(path,opt1)
	newdoc.SaveAs(newpath)
	newdoc.Close(False)
try:
	opt2 = RevitLinkOptions(False)
	linktype1 = RevitLinkType.CreateFromIFC(doc, path, newpath, True, opt2)
except:
	link_exists = True
if not link_exists:
	inst1 = RevitLinkInstance.Create(doc, linktype1.ElementId)
if link_exists:
	fec1 = FilteredElementCollector(doc).OfClass(RevitLinkInstance).GetElementIterator()
	fec1.Reset()
	for c in fec1:
		linktype2 = doc.GetElement(c.GetTypeId())
		linkpath0 = linktype2.GetExternalFileReference().GetPath()
		linkpath1 = ModelPathUtils.ConvertModelPathToUserVisiblePath(linkpath0)
		if linkpath1 == newpath:
			inst1 = c
			break
#temporarily modify the view's clip depth
subt1 = SubTransaction(doc)
fco = view.LookupParameter("Far Clip Offset")
cutoff2 = UnitUtils.ConvertToInternalUnits(cutoff1, DisplayUnitType.DUT_METERS)
subt1.Start()
parset1 = fco.Set(cutoff2)
doc.Regenerate()
#extract only the visible elements
fec3 = FilteredElementCollector(doc, view.Id).OfCategoryId(Cat1.Id).ToElements()
VisibleEl = [e.ToDSType(True) for e in fec3]
subt1.RollBack()
TransactionManager.Instance.TransactionTaskDone()

#get all elementsfrom the linked IFC
LinkDoc = inst1.GetLinkDocument()
fec2 = FilteredElementCollector(LinkDoc).OfCategoryId(Cat1.Id).WhereElementIsNotElementType().ToElements()
IfcEl = [e.ToDSType(True) for e in fec2]
linktype3 = doc.GetElement(inst1.GetTypeId())
#get view scale, size and direction
vscale = view.Scale
viewR = view.RightDirection.ToVector()
#get the tag dimensions and scale
tagscale = IfcTag.GetParameterValueByName("L") * vscale/2
#get the crop region and shrink appropriately to the tagscale
cbox = view.CropBox
boxmin =cbox.Min.ToPoint()
boxmax = cbox.Max.ToPoint()
dynbox0 = Cuboid.ByCorners(boxmin, boxmax)
tf1 = cbox.Transform
cs1 = CoordinateSystem.ByOriginVectors(tf1.Origin.ToPoint(),tf1.BasisX.ToVector(),tf1.BasisY.ToVector(), tf1.BasisZ.ToVector())
dynbox = dynbox0.Transform(cs1)
dyncrop1 = dynbox.Intersect(view_pl)[0].PerimeterCurves()
viewdims = dynbox.Width
dynpts = [c.StartPoint for c in dyncrop1]
v1 = Vector.ByTwoPoints(dynpts[0], dynpts[3]).Normalized().Scale(tagscale)
v2 = Vector.ByTwoPoints(dynpts[1], dynpts[2]).Normalized().Scale(tagscale)
dynpts[0] = dynpts[0].Add(v1)
dynpts[3] = dynpts[3].Add(v1.Reverse())
dynpts[1] = dynpts[1].Add(v2)
dynpts[2] = dynpts[2].Add(v2.Reverse())
dyncrop2 = Rectangle.ByCornerPoints(dynpts)
#get all elements from the local file
fec4 = FilteredElementCollector(doc).OfCategoryId(Cat1.Id).WhereElementIsNotElementType().ToElements()
LocalEl = [e.ToDSType(True) for e in fec4]

OUT = IfcEl, linktype3, view_pl, VisibleEl, dyncrop2, IfcTag, viewdims, viewR, LocalEl
# ----------------------------------------
code_block = CodeBlock(multi1=multi_box_1)
# ---------- code_block.designscript (19 lines) ----------
IfcEl = multi1[0];
LocalEl = multi1[8];
IFCelId = IfcEl.GetParameterValueByName("IfcGUID");
LocalElId = LocalEl.GetParameterValueByName("IfcGUID");
newind = IndexOf(LocalElId,IFCelId<1>);
ordered = Reorder(IfcEl,newind);
readval = ordered<1>.GetParameterValueByName("IfcMaterial");
readval2 = replace1(readval,"No description");
setval = LocalEl.SetParameterByName("Comments", readval2);
IfcLinkType = multi1[1];
plane1 = multi1[2];
visible1 = multi1[3];
cbox = multi1[4];
IfcTag = multi1[5];
margin1 = multi1[6];
viewR = multi1[7];
loc1 = elementpt1(visible1,plane1);
ap1 = PtAverage(loc1);
loc2 =tagpts1(loc1,ap1,cbox,viewR,margin1,plane1);
# ----------------------------------------
discard_ifc_link = Python(IN[0]=code_block.IfcLinkType)
# ---------- discard_ifc_link.python (18 lines) ----------
import clr

clr.AddReference("RevitServices")
import RevitServices
from RevitServices.Persistence import DocumentManager
from RevitServices.Transactions import TransactionManager
doc = DocumentManager.Instance.CurrentDBDocument


link1 = UnwrapElement(IN[0])

TransactionManager.Instance.EnsureInTransaction(doc)
try:
	doc.Delete(link1.Id)
	OUT = "Ok"
except:
	OUT = "Failed"
TransactionManager.Instance.TransactionTaskDone()
# ----------------------------------------
helper_functions = CodeBlock()
# ---------- helper_functions.designscript (27 lines) ----------
def PtAverage(pts:var[])
{
return = Point.ByCoordinates(Math.Average(pts.X),
Math.Average(pts.Y),Math.Average(pts.Z));
};

def replace1(val,rep)
{
return = (val == "" ? rep : val);
};

def elementpt1(elt1,pl1)
{
bb1 = elt1.BoundingBox;
pt1 = PtAverage({bb1.MinPoint,bb1.MaxPoint});
return = pl1.ClosestPointTo(pt1);
};

def tagpts1(pt1,ap1,box,v1,margin,pl1)
{
test1  = ((pt1.X - ap1.X) + (pt1.Y - ap1.Y)) > 0;
test2 = v1.X < 0 || v1.Y < 0 ? !test1 : test1;
l1 = test2 ? Line.ByStartPointDirectionLength(pt1,v1,margin+1):
Line.ByStartPointDirectionLength(pt1,v1.Reverse(),margin+1);
pt2 = box.Intersect(l1)[0];
return = DSCore.Object.IsNull(pt2) ? ap1 : pt2;
};
# ----------------------------------------
create_tags = BoolSelector(true)
multi_box_2 = Python(IN[0]=code_block.visible1, IN[1]=code_block.IfcTag, IN[2]=code_block.loc2, IN[3]=create_tags)
# ---------- multi_box_2.python (77 lines) ----------
import clr
import math

clr.AddReference("RevitNodes")
import Revit
clr.ImportExtensions(Revit.Elements)
clr.ImportExtensions(Revit.GeometryConversion)

clr.AddReference("RevitServices")
import RevitServices
from RevitServices.Persistence import DocumentManager
from RevitServices.Transactions import TransactionManager

doc = DocumentManager.Instance.CurrentDBDocument

clr.AddReference("RevitAPI")
import Autodesk
from Autodesk.Revit.DB import *

clr.AddReference('ProtoGeometry')
from Autodesk.DesignScript.Geometry import *

families = UnwrapElement(IN[0])
TagType0 = IN[1]
pts = UnwrapElement(IN[2])
boolean = IN[3]
view = doc.ActiveView
vscale = view.Scale
margin = TagType0.GetParameterValueByName("W") * 1.1 * vscale #+10% buffer
TagType = UnwrapElement(TagType0)
#distribute overlapping points
def distribute1(pts):
	clusters = []
	for i in xrange(len(pts)):
		distances = [pts[i].DistanceTo(pts[j]) for j in xrange(len(pts))]
		cluster = []
		for k in xrange(len(distances)):
			if distances[k] < margin:
				cluster.append(k)
		if len(cluster) > 1 and cluster not in clusters:
			clusters.append(cluster)
	ptcluster = [[pts[cc] for cc in c] for c in clusters]
	for ptsfk in ptcluster:
		len1 = len(ptsfk)
		avg_z = sum(p.Z for p in ptsfk) / len1
		start_z = avg_z  - math.floor(len1/2) * margin
		for i in xrange(len1):
			ptsfk[i] = Point.ByCoordinates(ptsfk[i].X,ptsfk[i].Y,start_z)
			start_z += margin
	for i in xrange(len(clusters)):
		for j in xrange(len(clusters[i])):
			pts[clusters[i][j]] = ptcluster[i][j]
	return pts
pts = distribute1(pts)
#create the tags
if boolean:
	TransactionManager.Instance.EnsureInTransaction(doc)
	tags = []
	rvtPoints = [p.ToXyz() for p in pts]
	tm1 = TagMode.TM_ADDBY_CATEGORY
	to1 = TagOrientation.Horizontal
	for i, j in zip(families, rvtPoints):
		tag = doc.Create.NewTag(view, i, True , tm1, to1, j)
		tag.ChangeTypeId(TagType.Id)
		tag.TagHeadPosition = j
		#par1 = tag.LookupParameter("Leader Line")
		#setpar1 = par1.Set(1)
		tags.append(tag)#.ToDSType(False)) #uncomment to not create duplicates
	OUT = tags
	#uncross the newly created tags
	#def tagline(tag1):
	#	s1 = tag1.TagHeadPosition.ToPoint()
	#	e1 = tag1.LeaderEnd.ToPoint()
	#	return Line.ByStartPointEndPoint(s1,e1)
	TransactionManager.Instance.TransactionTaskDone()
else:
	OUT = "Tag Creation is disabled.\nPlease set to True"
# ----------------------------------------
# note: TO DO:
# + tag placement:
#  - tag leaders mustn't cross. Can't seem to be able to get the leader end with the API.
# + better handling of null references
# + combine the CBN inside a single PSN ?
watch = Watch(multi_box_2)
