# Dynamo graph IfcGetParameters.dyn (Dynamo 0.7.6.4256)

code_block = CodeBlock()
# ---------- code_block.designscript (6 lines) ----------
def apply1(el,par:var[],val:var[])
{
el.SetParameterByName(par[0],val[0]);
el.SetParameterByName(par[1],val[1]);
return = el;
};
# ----------------------------------------
file_path = Filename("E:\DIMITAR\GitHub\Sports_Complex\IFC Roundtrip\FreeCAD Detail\detail_Yorik_notris.ifc")
categories = Categories("GenericModel")
python_script = Python(IN[0]=file_path, IN[1]=categories)
# ---------- python_script.python (72 lines) ----------
import clr

clr.AddReference("RevitServices")
import RevitServices
from RevitServices.Persistence import DocumentManager
from RevitServices.Transactions import TransactionManager

doc = DocumentManager.Instance.CurrentDBDocument
uiapp = DocumentManager.Instance.CurrentUIApplication
app = uiapp.Application

clr.AddReference("System")
from System.Diagnostics import Process

clr.AddReference("RevitAPI")
from  Autodesk.Revit.DB import RevitLinkType, RevitLinkOptions, RevitLinkInstance, FilteredElementCollector, FilePath, ModelPathUtils, FilteredElementCollector, ElementCategoryFilter
from  Autodesk.Revit.DB.IFC import *

clr.AddReference("RevitNodes")
import Revit
clr.ImportExtensions(Revit.Elements)

import sys
sys.path.append(r'C:\Program Files (x86)\IronPython 2.7\Lib')
import os

path = IN[0]
Cat1 = UnwrapElement(IN[1])
newpath = path[:-3] + "RVT"
file_exists = os.path.exists(newpath)
link_exists = False
ltype = []

TransactionManager.Instance.EnsureInTransaction(doc)
if not file_exists:
	opt1 = IFCImportOptions()
	opt1.Action = IFCImportAction.Open
	opt1.Intent = IFCImportIntent.Reference
	newdoc = app.OpenIFCDocument(path,opt1)
	newdoc.SaveAs(newpath)
	newdoc.Close(False)
try:
	opt2 = RevitLinkOptions(False)
	linktype1 = RevitLinkType.CreateFromIFC(doc, path, newpath, True, opt2)
	ltype.append(linktype1)
except:
	link_exists = True
if not link_exists:
	inst1 = RevitLinkInstance.Create(doc, ltype[0].ElementId)
if link_exists:
	collector = FilteredElementCollector(doc)
	collector.OfClass(RevitLinkInstance)
	collector1 = collector.GetElementIterator()
	collector1.Reset()
	for c in collector1:
		linktype2 = doc.GetElement(c.GetTypeId())
		linkpath0 = linktype2.GetExternalFileReference().GetPath()
		linkpath1 = ModelPathUtils.ConvertModelPathToUserVisiblePath(linkpath0)
		if linkpath1 == newpath:
			inst1 = c
			break
TransactionManager.Instance.TransactionTaskDone()

LinkDoc = inst1.GetLinkDocument()
collector = FilteredElementCollector(LinkDoc)
filter = ElementCategoryFilter(Cat1.Id)
list1 = collector.WherePasses(filter).WhereElementIsNotElementType().ToElements()
list2 = []
for l in list1:
	list2.append(l.ToDSType(True))
linktype3 = doc.GetElement(inst1.GetTypeId())
OUT = list2, linktype3
# ----------------------------------------
all_elements_of_category = ElementsOfCategory(categories)
code_block_2 = CodeBlock { param_name = {"IfcMaterial","Reference(PropertySet)"}; isinstance = true; param_group = "PG_IFC"; }
python_script_2 = Python(IN[0]=file_path, IN[1]=code_block_2.param_name, IN[2]=code_block_2.isinstance, IN[3]=code_block_2.param_group, IN[4]=categories, IN[5]=python_script)
# ---------- python_script_2.python (68 lines) ----------
import clr

clr.AddReference("RevitServices")
import RevitServices
from RevitServices.Persistence import DocumentManager
from RevitServices.Transactions import TransactionManager

doc = DocumentManager.Instance.CurrentDBDocument
uiapp = DocumentManager.Instance.CurrentUIApplication
app = uiapp.Application

import System
from System.Collections.Generic import *

clr.AddReference("RevitAPI")
from  Autodesk.Revit.DB import BuiltInParameterGroup, BuiltInCategory

import sys
sys.path.append(r'C:\Program Files (x86)\IronPython 2.7\Lib')
import os

path = IN[0]
param_name = IN[1]
isinstance = IN[2]
param_group = IN[3]
param_cat = UnwrapElement(IN[4])
waitforfilecreation = IN[5]
newpath = path + ".sharedparameters.txt"
file_exists = os.path.exists(newpath)

TransactionManager.Instance.EnsureInTransaction(doc)
if not file_exists:
	OUT = "No Shared Parameters file found!"
else:
	if file_exists:
		app.SharedParametersFilename = newpath
	file = app.OpenSharedParameterFile()
	params = []
	groups = file.Groups
	for g in groups:
		params.append(g.Definitions)
	definitions = []
	for pn in param_name:
		for p in params:
			if not p.IsEmpty and p.Contains(p.Item[pn]):
				definitions.append(p.Item[pn])
				
all_param_groups = System.Enum.GetValues(BuiltInParameterGroup)
for g in all_param_groups:
	if str(g) == param_group:
		param_group1 = g
		break

builtInCat = System.Enum.ToObject(BuiltInCategory, param_cat.Id.IntegerValue)
cats = app.Create.NewCategorySet()
cats.Insert(doc.Settings.Categories.get_Item(builtInCat))
if isinstance:
	bind = app.Create.NewInstanceBinding(cats)
else:
	bind = app.Create.NewTypeBinding(cats)
output = []	
parametermap = doc.ParameterBindings
for d in definitions:
	if not parametermap.Contains(d):
		output.append(parametermap.Insert(d, bind, param_group1))

TransactionManager.Instance.TransactionTaskDone()
OUT = output
# ----------------------------------------
code_block_3 = CodeBlock(IfcLink=python_script, local1=all_elements_of_category, params=code_block_2.param_name, newparams=python_script_2)
# ---------- code_block_3.designscript (9 lines) ----------
link1 = IfcLink[0];
linkel = link1.GetParameterValueByName("IfcGUID");
localel = local1.GetParameterValueByName("IfcGUID");
newind = IndexOf(localel,linkel<1>);
ordered = Reorder(link1,newind);
readval = ordered<1>.GetParameterValueByName(params<2>);
AllTrue(newparams);
apply1(local1,params,readval);
IfcEl = IfcLink[1];
# ----------------------------------------
watch = Watch(code_block_3.readval)
eraser = Custom[Tool.Eraser](Element_s=code_block_3.IfcEl)  # Try to delete any element from project
