# Dynamo graph IfcGetParameters2.dyn (Dynamo 0.7.6.4256)

code_block = CodeBlock()
# ---------- code_block.designscript (24 lines) ----------
def replace1(val,rep)
{
return = (val == "" ? rep : val);
};

def elementpt1(elt1,pl1)
{
min = elt1.BoundingBox.MinPoint;
max = elt1.BoundingBox.MaxPoint;
pt1 = Point.ByCoordinates(Math.Average({min.X,max.X}),
Math.Average({min.Y,max.Y}),Math.Average({min.Z,max.Z}));
pt2 = pt1.Project(pl1,pl1.Normal);
pt2a = pt1.Project(pl1,pl1.Normal.Reverse());
return = (List.IsEmpty(pt2) ? pt2a[0] : pt2[0]);
};

def tagpts1(pt1,ap1,m1)
{
v1 = (pt1.X == ap1.X ? Vector.ByCoordinates(0,m1) :
Vector.ByCoordinates(m1,0) );
pt2 = (pt1.Y > ap1.Y ? pt1.Add(v1) :
pt1.Add(v1.Reverse()) );
return = pt2;
};
# ----------------------------------------
file_path = Filename("E:\DIMITAR\GitHub\Sports_Complex\IFC Roundtrip\FreeCAD Detail\detail_Yorik_notris.ifc")
file_path_2 = Filename("D:\GitHub\Sports_Complex\IFC Roundtrip\FreeCAD Detail\detail_Yorik_notris.ifc")
categories = Categories("GenericModel")
python_script = Python(IN[0]=file_path_2, IN[1]=categories)
# ---------- python_script.python (72 lines) ----------
import clr

clr.AddReference("RevitServices")
import RevitServices
from RevitServices.Persistence import DocumentManager
from RevitServices.Transactions import TransactionManager

doc = DocumentManager.Instance.CurrentDBDocument
uiapp = DocumentManager.Instance.CurrentUIApplication
app = uiapp.Application

clr.AddReference("System")
from System.Diagnostics import Process

clr.AddReference("RevitAPI")
from  Autodesk.Revit.DB import RevitLinkType, RevitLinkOptions, RevitLinkInstance, FilteredElementCollector, FilePath, ModelPathUtils, FilteredElementCollector, ElementCategoryFilter
from  Autodesk.Revit.DB.IFC import *

clr.AddReference("RevitNodes")
import Revit
clr.ImportExtensions(Revit.Elements)

import sys
sys.path.append(r'C:\Program Files (x86)\IronPython 2.7\Lib')
import os

path = IN[0]
Cat1 = UnwrapElement(IN[1])
newpath = path[:-3] + "RVT"
file_exists = os.path.exists(newpath)
link_exists = False
ltype = []

TransactionManager.Instance.EnsureInTransaction(doc)
if not file_exists:
	opt1 = IFCImportOptions()
	opt1.Action = IFCImportAction.Open
	opt1.Intent = IFCImportIntent.Reference
	newdoc = app.OpenIFCDocument(path,opt1)
	newdoc.SaveAs(newpath)
	newdoc.Close(False)
try:
	opt2 = RevitLinkOptions(False)
	linktype1 = RevitLinkType.CreateFromIFC(doc, path, newpath, True, opt2)
	ltype.append(linktype1)
except:
	link_exists = True
if not link_exists:
	inst1 = RevitLinkInstance.Create(doc, ltype[0].ElementId)
if link_exists:
	collector = FilteredElementCollector(doc)
	collector.OfClass(RevitLinkInstance)
	collector1 = collector.GetElementIterator()
	collector1.Reset()
	for c in collector1:
		linktype2 = doc.GetElement(c.GetTypeId())
		linkpath0 = linktype2.GetExternalFileReference().GetPath()
		linkpath1 = ModelPathUtils.ConvertModelPathToUserVisiblePath(linkpath0)
		if linkpath1 == newpath:
			inst1 = c
			break
TransactionManager.Instance.TransactionTaskDone()

LinkDoc = inst1.GetLinkDocument()
collector = FilteredElementCollector(LinkDoc)
filter = ElementCategoryFilter(Cat1.Id)
list1 = collector.WherePasses(filter).WhereElementIsNotElementType().ToElements()
list2 = []
for l in list1:
	list2.append(l.ToDSType(True))
linktype3 = doc.GetElement(inst1.GetTypeId())
OUT = list2, linktype3
# ----------------------------------------
all_elements_of_category = ElementsOfCategory(categories)
python_script_2 = Python(IN[0]=all_elements_of_category, IN[1]=categories)
# ---------- python_script_2.python (36 lines) ----------
import clr

clr.AddReference("RevitServices")
import RevitServices
from RevitServices.Persistence import DocumentManager
from RevitServices.Transactions import TransactionManager

doc = DocumentManager.Instance.CurrentDBDocument

clr.AddReference("RevitNodes")
import Revit
clr.ImportExtensions(Revit.GeometryConversion)

clr.AddReference('ProtoGeometry')
from Autodesk.DesignScript.Geometry import *

clr.AddReference("RevitAPI")
import Autodesk
from Autodesk.Revit.DB import FilteredElementCollector

view = doc.ActiveView
view_or = view.Origin.ToPoint()
view_nr = view.ViewDirection.ToVector()
view_pl = Plane.ByOriginNormal(view_or,view_nr)

elements = UnwrapElement(IN[0])
cat = UnwrapElement(IN[1])
visible = []
fec1 = FilteredElementCollector(doc, view.Id)
fec1.OfCategoryId(cat.Id)
fec2 = fec1.GetElementIterator()
fec2.Reset()
for e in fec2:
	visible.append(e)

OUT = view_pl, visible
# ----------------------------------------
code_block_2 = CodeBlock { tagoffset = 0.5; }
code_block_3 = CodeBlock(IfcLink=python_script, local1=all_elements_of_category, active=python_script_2, margin1=code_block_2)
# ---------- code_block_3.designscript (17 lines) ----------
link1 = IfcLink[0];
linkel = link1.GetParameterValueByName("IfcGUID");
localel = local1.GetParameterValueByName("IfcGUID");
newind = IndexOf(localel,linkel<1>);
ordered = Reorder(link1,newind);
readval = ordered<1>.GetParameterValueByName("IfcMaterial");
readval2 = replace1(readval,"None");
setval = local1.SetParameterByName("Comments", readval2);
IfcEl = IfcLink[1];
fs1 = FamilySymbol.ByFamilyNameAndTypeName("IfcTag"
,"Comments");
plane1 = active[0];
viewel1 = active[1];
loc1 = elementpt1(viewel1,plane1);
ap1 = Point.ByCoordinates(Math.Average(loc1.X),
Math.Average(loc1.Y),Math.Average(loc1.Z));
loc2 =tagpts1(loc1,ap1,margin1);
# ----------------------------------------
python_script_3 = Python(IN[0]=code_block_3.IfcEl)
# ---------- python_script_3.python (18 lines) ----------
import clr

clr.AddReference("RevitServices")
import RevitServices
from RevitServices.Persistence import DocumentManager
from RevitServices.Transactions import TransactionManager
doc = DocumentManager.Instance.CurrentDBDocument


link1 = UnwrapElement(IN[0])

TransactionManager.Instance.EnsureInTransaction(doc)
try:
	doc.Delete(link1.Id)
	OUT = "Ok"
except:
	OUT = "Failed"
TransactionManager.Instance.TransactionTaskDone()
# ----------------------------------------
code_block_4 = CodeBlock { overlapcheck = 0.3; }
python_script_4 = Python(IN[0]=code_block_3.loc2, IN[1]=code_block_4)
# ---------- python_script_4.python (20 lines) ----------
import clr
clr.AddReference('ProtoGeometry')
from Autodesk.DesignScript.Geometry import *
#The inputs to this node will be stored as a list in the IN variable.
dataEnteringNode = IN
pts = IN[0]
margin = IN[1]
ind1 = []
for p in pts:
	l1 = []
	for i in range(len(pts)):
		l1.append(p.DistanceTo(pts[i]))
	for d in l1:
		if d < margin and d != 0:
			ind1.append(l1.index(d))
ind2 = ind1[0:len(ind1)/2]
v1 = Vector.ByCoordinates(0,0,margin)
for i in ind2:
	pts[i] = pts[i].Add(v1)
OUT = pts
# ----------------------------------------
boolean = BoolSelector(true)
python_script_5 = Python(IN[0]=code_block_3.fs1, IN[1]=code_block_3.viewel1, IN[2]=python_script_4, IN[3]=boolean)
# ---------- python_script_5.python (44 lines) ----------
import clr

clr.AddReference("RevitNodes")
import Revit
clr.ImportExtensions(Revit.Elements)
clr.ImportExtensions(Revit.GeometryConversion)

clr.AddReference("RevitServices")
import RevitServices
from RevitServices.Persistence import DocumentManager
from RevitServices.Transactions import TransactionManager

doc = DocumentManager.Instance.CurrentDBDocument

clr.AddReference("RevitAPI")
import Autodesk
from Autodesk.Revit.DB import *

dataEnteringNode = IN

symType = UnwrapElement(IN[0])
families = UnwrapElement(IN[1])
points = UnwrapElement(IN[2])
boolean = IN[3]

view = doc.ActiveView
TransactionManager.Instance.EnsureInTransaction(doc)

if boolean:
	tags = []
	rvtPoints = []
	for p in points:
		rvtPoints.append(p.ToXyz(True))
	tm1 = TagMode.TM_ADDBY_CATEGORY
	to1 = TagOrientation.Horizontal
	for i, j in zip(families, rvtPoints):
		tag = doc.Create.NewTag(view, i, False , tm1, to1, j)
		tag.ChangeTypeId(symType.Id)
		tags.append(tag.ToDSType(False))
	OUT = tags
else:
	OUT = "Please set to True"

TransactionManager.Instance.TransactionTaskDone()
# ----------------------------------------
code_block_5 = CodeBlock(tags=python_script_5) { tags.SetParameterByName("Leader Line", 1); }
watch = Watch(python_script_5)
