# Dynamo graph IfcSaveAsReference.dyn (Dynamo 0.8.0.856)

file_path = Filename("F:\detail_Yorik.ifc")
python_script = Python(IN[0]=file_path)
# ---------- python_script.python (27 lines) ----------
import clr
# Import DocumentManager
clr.AddReference("RevitServices")
import RevitServices
from RevitServices.Persistence import DocumentManager
from RevitServices.Transactions import TransactionManager

doc = DocumentManager.Instance.CurrentDBDocument
uiapp = DocumentManager.Instance.CurrentUIApplication
app = uiapp.Application

clr.AddReference("RevitAPI")
from  Autodesk.Revit.DB.IFC import *

dataEnteringNode = IN
path = IN[0]
opt1 = IFCImportOptions()
opt1.Action = IFCImportAction.Open
opt1.Intent = IFCImportIntent.Reference
newdoc = app.OpenIFCDocument(path,opt1)
newpath = path[:-3] + "rvt"
try:
	newdoc.SaveAs(newpath)
	newdoc.Close(False)
	OUT = "File succesfully saved at %s." %newpath
except:
	OUT = "An error ocurred. A file with the same name might already exist in the specified folder."
# ----------------------------------------
watch = Watch(python_script)
