# Dynamo graph TagMaterials1.dyn (Dynamo 0.8.2.1953)

helper_functions = CodeBlock()
# ---------- helper_functions.designscript (15 lines) ----------
def PtAverage(pts:var[])
{
return = Point.ByCoordinates(Math.Average(pts.X),
Math.Average(pts.Y),Math.Average(pts.Z));
};

def tagpts1(pt1,ap1,box,v1,margin,pl1)
{
test1  = ((pt1.X - ap1.X) + (pt1.Y - ap1.Y)) > 0;
test2 = v1.X < 0 || v1.Y < 0 ? !test1 : test1;
l1 = test2 ? Line.ByStartPointDirectionLength(pt1,v1,margin):
Line.ByStartPointDirectionLength(pt1,v1.Reverse(),margin);
pt2 = box.Intersect(l1)[0];
return = DSCore.Object.IsNull(pt2) ? ap1 : pt2;
};
# ----------------------------------------
categories = Categories("GenericModel")
# note: This is the depth at which elements will be tagged. Try to keep it to a realistic view depth.
# note: In our particular case all elements are
# modeled as Generic Models
view_depth_cut_off_distance_m = DoubleSlider(0.1, range=0.001..1 step 0.01)
# note: Please parametrize the width
# (W) and length (L) of your tag.
material_tag_type = FamilyTypes("Material Tag 1:Name")
# note: After running the graphfor the first time, Dynamo can't guess when you've made any changes inside Revit. Toggle the "Refresh" bool once to notify Dynamo of any changes. This may include but is not limited to:
#    - changing the active view
#    - editing the view crop box
#    - editing the view scale
refresh = BoolSelector(false)
multi_box_1 = Python(IN[0]=categories, IN[1]=view_depth_cut_off_distance_m, IN[2]=material_tag_type, IN[3]=refresh)
# ---------- multi_box_1.python (80 lines) ----------
import clr

clr.AddReference("RevitServices")
import RevitServices
from RevitServices.Persistence import DocumentManager
from RevitServices.Transactions import TransactionManager

doc = DocumentManager.Instance.CurrentDBDocument
uiapp = DocumentManager.Instance.CurrentUIApplication
app = uiapp.Application

clr.AddReference("RevitAPI")
from  Autodesk.Revit.DB import *

clr.AddReference("RevitNodes")
import Revit
clr.ImportExtensions(Revit.Elements)
clr.ImportExtensions(Revit.GeometryConversion)

clr.AddReference('ProtoGeometry')
from Autodesk.DesignScript.Geometry import *

Cat1 = UnwrapElement(IN[0])
cutoff1 = IN[1]
IfcTag = IN[2]
#get active view's data
view = doc.ActiveView
view_or = view.Origin.ToPoint()
view_nr = view.ViewDirection.ToVector()
view_pl = Plane.ByOriginNormal(view_or,view_nr)

TransactionManager.Instance.EnsureInTransaction(doc)
#temporarily modify the view's clip depth
subt1 = SubTransaction(doc)
fco = view.LookupParameter("Far Clip Offset")
cutoff2 = UnitUtils.ConvertToInternalUnits(cutoff1, DisplayUnitType.DUT_METERS)
subt1.Start()
parset1 = fco.Set(cutoff2)
doc.Regenerate()
#extract only the visible elements
fec1 = FilteredElementCollector(doc, view.Id).OfCategoryId(Cat1.Id).ToElements()
VisibleEl = [e.ToDSType(True) for e in fec1]
subt1.RollBack()
TransactionManager.Instance.TransactionTaskDone()

#get view scale, size and direction
vscale = view.Scale
viewR = view.RightDirection.ToVector()
#get the tag dimensions and scale
tagscale = IfcTag.GetParameterValueByName("L") * vscale/2
#tagscale2 = IfcTag.GetParameterValueByName("W") * vscale/2
#get the crop region and shrink appropriately to the tagscale
crop1 = view.GetCropRegionShapeManager().GetCropRegionShape()
dynpts = [c.GetEndPoint(0).ToPoint() for c in crop1]
v1 = Vector.ByTwoPoints(dynpts[0], dynpts[3]).Normalized().Scale(tagscale)
#v2 = Vector.ByTwoPoints(dynpts[0], dynpts[1]).Normalized().Scale(tagscale2)
dynpts[0] = dynpts[0].Add(v1.Reverse())
#dynpts[0] = dynpts[0].Add(v2)
dynpts[1] = dynpts[1].Add(v1.Reverse())
#dynpts[1] = dynpts[1].Add(v2.Reverse())
dynpts[2] = dynpts[2].Add(v1)
#dynpts[2] = dynpts[2].Add(v2.Reverse())
dynpts[3] = dynpts[3].Add(v1)
#dynpts[3] = dynpts[3].Add(v2)
dyncrop = Rectangle.ByCornerPoints(dynpts)
viewdims = crop1.GetRectangularHeight(crop1.GetPlane())
#get an accurate element location point in the view
cbox = view.CropBox
boxmin =cbox.Min.ToPoint()
boxmax = cbox.Max.ToPoint()
viewbox = Cuboid.ByCorners(boxmin, boxmax)
tf1 = cbox.Transform
cs1 = CoordinateSystem.ByOriginVectors(tf1.Origin.ToPoint(),tf1.BasisX.ToVector(),tf1.BasisY.ToVector(), tf1.BasisZ.ToVector())
viewbox = viewbox.Transform(cs1)
ElSolid = [e.Geometry()[0] for e in VisibleEl]
ElBoxes = [viewbox.Intersect(b)[0] for b in ElSolid]
ElLoc1 = [s1.ClosestPointTo(dyncrop) for s1 in ElBoxes]
ElLoc2 = [view_pl.ClosestPointTo(pt) for pt in ElLoc1]

OUT = view_pl, VisibleEl, dyncrop, IfcTag, viewdims, viewR, ElLoc2
# ----------------------------------------
code_block = CodeBlock(multi1=multi_box_1)
# ---------- code_block.designscript (9 lines) ----------
plane1 = multi1[0];
visible1 = multi1[1];
cbox = multi1[2];
IfcTag = multi1[3];
margin1 = multi1[4];
viewR = multi1[5];
loc1 = multi1[6];
ap1 = PtAverage(loc1);
loc2 =tagpts1(loc1,ap1,cbox,viewR,margin1,plane1);
# ----------------------------------------
# note: Once the material tags are created, they will be automatically selected inside the Revit UI.
# You'll need to nudge them once with the keyboard arrow keys( either up+down or left+right).
# This is due to a Revit limitation and is unavoidable at this stage.
create_new_tags = BoolSelector(true)
multi_box_2 = Python(IN[0]=code_block.visible1, IN[1]=code_block.IfcTag, IN[2]=code_block.loc1, IN[3]=code_block.loc2, IN[4]=create_new_tags)
# ---------- multi_box_2.python (87 lines) ----------
import clr
import math

clr.AddReference("RevitNodes")
import Revit
clr.ImportExtensions(Revit.Elements)
clr.ImportExtensions(Revit.GeometryConversion)

clr.AddReference("RevitServices")
import RevitServices
from RevitServices.Persistence import DocumentManager
from RevitServices.Transactions import TransactionManager

doc = DocumentManager.Instance.CurrentDBDocument
uidoc = DocumentManager.Instance.CurrentUIApplication.ActiveUIDocument

clr.AddReference("RevitAPI")
import Autodesk
from Autodesk.Revit.DB import *

clr.AddReference('ProtoGeometry')
from Autodesk.DesignScript.Geometry import *

ElementsToTag = UnwrapElement(IN[0])
TagType0 = IN[1]
ElementPt = UnwrapElement(IN[2])
pts = UnwrapElement(IN[3])
boolean = IN[4]

view = doc.ActiveView
vscale = view.Scale
margin = TagType0.GetParameterValueByName("W") * 1.1 * vscale #+10% buffer
TagType = UnwrapElement(TagType0)
#collect all existing tags in the view and the tagged elements
ViewTags = FilteredElementCollector(doc).OfClass(IndependentTag).OwnedByView(view.Id).ToElements()
TaggedElId = [t.TaggedLocalElementId for t in ViewTags]
#distribute overlapping points
def distribute1(pts):
	clusters = []
	for i in xrange(len(pts)):
		distances = [pts[i].DistanceTo(pts[j]) for j in xrange(len(pts))]
		cluster = []
		for k in xrange(len(distances)):
			if distances[k] < margin:
				cluster.append(k)
		if len(cluster) > 1 and cluster not in clusters:
			clusters.append(cluster)
	ptcluster = [[pts[cc] for cc in c] for c in clusters]
	for ptsfk in ptcluster:
		len1 = len(ptsfk)
		avg_z = sum(p.Z for p in ptsfk) / len1
		start_z = avg_z  - math.floor(len1/2) * margin
		for i in xrange(len1):
			ptsfk[i] = Point.ByCoordinates(ptsfk[i].X,ptsfk[i].Y,start_z)
			start_z += margin
	for i in xrange(len(clusters)):
		for j in xrange(len(clusters[i])):
			pts[clusters[i][j]] = ptcluster[i][j]
	return pts
pts = distribute1(pts)
#create the tags
if boolean:
	TransactionManager.Instance.EnsureInTransaction(doc)
	tags = []
	tagHead = [p.ToXyz() for p in pts]
	tagEndP = [p1.ToXyz() for p1 in ElementPt]
	tm1 = TagMode.TM_ADDBY_MATERIAL
	to1 = TagOrientation.Horizontal
	for i, j, k in zip(ElementsToTag, tagHead, tagEndP):
		if i.Id not in TaggedElId:
			tag = doc.Create.NewTag(view, i, True , tm1, to1, j)
			tag.ChangeTypeId(TagType.Id)
			tag.TagHeadPosition = j
			tag.LeaderEnd = k
			#par1 = tag.LookupParameter("Leader Line")
			#setpar1 = par1.Set(1)
			tags.append(tag)
	UiSelect = [uidoc.Selection.Elements.Add(t) for t in tags]
	TransactionManager.Instance.TransactionTaskDone()
	OUT = tags
	#uncross the newly created tags
	#def tagline(tag1):
	#	s1 = tag1.TagHeadPosition.ToPoint()
	#	e1 = tag1.LeaderEnd.ToPoint()
	#	return Line.ByStartPointEndPoint(s1,e1)
else:
	OUT = "Tag creation is disabled.\nPlease set to True"
# ----------------------------------------
# note: TO DO:
# + tag placement:
#  - tag leaders mustn't cross. (leader ends are onlt accessible for free end tags)
# + better handling of null references
# + combine the CBN inside a single PSN ?
watch = Watch(multi_box_2)
