# Dynamo graph IFCWallTag.dyn (Dynamo 0.7.6.4256)

get_documents = Custom[Get Documents]()  # Queries all linked Revit files and retrieves their Name, LinkInstance and Document properties.
watch = Watch(get_documents.Link_Name)
family_types = FamilyTypes("IFC_Wall Tag:Wall Tag 1")
categories = Categories("Walls")
getFromLinkedFile = Custom[Element.GetFromLinkedFile](Link_Instance=get_documents.Link_Instance, Link_Document=get_documents.Link_Doc, Category=categories)  # Get elements from link document instance based on category
code_block = CodeBlock(ifcwalls=getFromLinkedFile)
# ---------- code_block.designscript (3 lines) ----------
wallloc = Flatten(ifcwalls.Geometry().Centroid());
pts = Point.ByCoordinates(wallloc.X,wallloc.Y,0);
ifcwalls.GetParameterValueByName("Reference(Pset_WallCommon)");
# ----------------------------------------
levels = Levels("Level 1")
byPointAndLevel = FamilyInstance.ByPointAndLevel(family_types, code_block.pts, levels)
code_block_2 = CodeBlock(tags=byPointAndLevel, val1=code_block.out2) { tags.SetParameterByName("IFCName",val1); }
watch_2 = Watch(getFromLinkedFile)
