# Dynamo graph Bidirectional Excel Door Schedule.dyn (Dynamo 0.8.1.1942)

categories = Categories("Doors")
all_elements_of_category = ElementsOfCategory(categories)
string = StringInput("Hardware")
getParameterValueByName = Element.GetParameterValueByName(element=all_elements_of_category, parameterName=string)
watch = Watch(getParameterValueByName)
getParameterValueByName_2 = Element.GetParameterValueByName(element=all_elements_of_category, parameterName=string)
string_2 = StringInput("Hardware")
